# Grasshopper definition solar_path_main.gh (Grasshopper 1.0.7)

minutes = Slider(12, range=0..60)
degrees = Slider(13, range=0..89)
division = Division(A=minutes, B=60)
series = Series(Start=-90, Step=15, Count=13)
addition = Addition(A=degrees, B=division)
list = ValueList({"Equinox": 0, "Summer Solstice": 23.45, "Winter Solstice": -23.45}, selected="Equinox")
rad = Radians(Degrees=series)
number_slider = Slider(60, range=0..100)
rad_2 = Radians(Degrees=addition)
rad_3 = Radians(Degrees=list)
panel = Panel(addition)
c_script = CSharpScript(r=number_slider, HRA=rad, LAT=rad_2, DEC=rad_3)  # -> out, rs, ds, ALT_values; inputs r: Double, HRA: Double, LAT: Double, DEC: Double
# ---------- c_script: C# ----------
    /*Convert to degrees*/
    double cdg = (180 / Math.PI);

    double ALT = (Math.Asin((Math.Sin(DEC) * Math.Sin(LAT)) + (Math.Cos(DEC) * Math.Cos(LAT) * Math.Cos(HRA))));

    List<double> ALT_list = new List<double>();
    ALT_list.Add(ALT);

    List<double> ALT_list_corrected = new List<double>();

    foreach (double i in ALT_list){
      ALT_list_corrected.Add(i * 1);

    }

/*
    foreach (int i in ALT_list){
      if (i < 6) {
        Console.WriteLine(ALT_list_corrected[i]);
      }}
 */

    rs = r * Math.Cos(DEC) / (Math.Sin(ALT) + Math.Sin(DEC));
    ds = r * ((Math.Cos(LAT)) * cdg) / (Math.Sin(LAT)*cdg + Math.Sin(DEC)*cdg);
    ALT_values = ALT_list_corrected[0];
# ---------- end c_script ----------
cir = Circle(Plane=PlaneXY(0, 0, 0), Radius=number_slider)
arc = Arc(Plane=PlaneXY(0, 0, 0), Radius=c_script.ds, Angle=Domain(0, 3.141592654))  # -> Arc, Length
deg = Degrees(Radians=c_script.ALT_values)
deg_2 = Degrees(Radians=c_script.ds)
split = SplitList(List=deg, Index=6)  # -> ListA, ListB
neg = Negative(Value=split.ListA)
panel_2 = Panel(c_script.ds)
cset = CreateSet(List=[neg, split.ListB])  # -> Set, Map
intcrv = Interpolate(Degree=1, Periodic=False, KnotStyle=1)  # -> Curve, Length, Domain
panel_3 = Panel(cset.Set)
